# Dynamo graph Create Grids & Levels.dyn (Dynamo 2.1.0.7500)

file_path = Filename("..\..\Users\denni\Downloads\AU Presentation - Grids and Levels (2).xlsx")
string = StringInput("Grids")
boolean = BoolSelector(true)
code_block = CodeBlock { 0; 1; 2; 3; 4; }
fromExcel = Custom[Grid.FromExcel](path=file_path, sheetName=string, removeHeader=boolean, Point1StartIndex=code_block.out0, Point1EndIndex=code_block.out1, Point2StartIndex=code_block.out2, Point2EndIndex=code_block.out3, MarkIndex=code_block.out4)  # Generates grids from an Excel spreadsheet. Tutorial: https://parametricmonkey.com/2015/06/21/grids-from-excel/
string_2 = StringInput("Levels")
boolean_2 = BoolSelector(true)
fromExcel_2 = Custom[Level.FromExcel](sheetName=string_2, removeHeadings=boolean_2)  # Generates levels from an Excel spreadsheet. Tutorial: https://parametricmonkey.com/2015/10/08/levels-from-excel/; unwired: path
file_path_2 = Filename(".\Grids and Levels.xlsx")
string_3 = StringInput("Grids")
number_slider = DoubleSlider(1, range=0..100 step 0.1)
python_script = Python()  # unwired: IN[0]
# ---------- python_script.python (59 lines) ----------
# SOM
# Written by Dennis Eldridge
#This will select all columns and change the linewieght based on it's level, and the input lineweight range.


import clr
clr.AddReference('ProtoGeometry')
from Autodesk.DesignScript.Geometry import *

# Import Element wrapper extension methods
clr.AddReference("RevitNodes")
import Revit
clr.ImportExtensions(Revit.Elements)

# Import geometry conversion extension methods

clr.ImportExtensions(Revit.GeometryConversion)

# Import DocumentManager and TransactionManager
clr.AddReference("RevitServices")
import RevitServices
from RevitServices.Persistence import DocumentManager
from RevitServices.Transactions import TransactionManager

doc = DocumentManager.Instance.CurrentDBDocument
uiapp = DocumentManager.Instance.CurrentUIApplication
app = uiapp.Application

# Import RevitAPI
clr.AddReference("RevitAPI")
import Autodesk
from Autodesk.Revit.DB import *

import sys
pyt_path = r'C:\Program Files (x86)\IronPython 2.7\Lib'
sys.path.append(pyt_path)
import System

sys.path.append("C:\Python27\Lib")
from string import ascii_letters

#Creates an object that can collect / find elements of any catagory
grid_collector = Autodesk.Revit.DB.FilteredElementCollector(doc)
grid_collector2 = Autodesk.Revit.DB.FilteredElementCollector(doc)

#Unwraps input
def Unwrap(item):
	return UnwrapElement(item)

output = [["Start X", "Start Y", "End X", "End Y", "Mark"]]
for grid in grid_collector.OfClass(Grid):
	grid_point1 = grid.Curve.GetEndPoint(0)
	grid_point2 = grid.Curve.GetEndPoint(1)
	start = str(grid_point1.X) + "," + str(grid_point1.Y) + "," + str(grid_point1.Z)
	end = str(grid_point2.X) + "," + str(grid_point2.Y) + "," + str(grid_point2.Z)
	output.append([grid_point1.X, grid_point1.Y, grid_point2.X, grid_point2.Y, grid.Name])

#Assign your output to the OUT variable.
OUT = output
# ----------------------------------------
boolean_3 = BoolSelector(true)
exportExcel = Data.ExportExcel(filePath=file_path_2, sheetName=string_3, startRow=number_slider, startCol=number_slider, data=python_script, overWrite=boolean_3)  # frozen
string_4 = StringInput("C:\scripts\Presentation")
file_path_3 = Filename(".\Grids and Levels.csv")
exportCSV = Data.ExportCSV(filePath=file_path_3, data=python_script)  # frozen
python_script_2 = Python(IN[0]=file_path_3)
# ---------- python_script_2.python (66 lines) ----------
# SOM
# Written by Dennis Eldridge
#This will select all columns and change the linewieght based on it's level, and the input lineweight range.


import clr
clr.AddReference('ProtoGeometry')
from Autodesk.DesignScript.Geometry import *

# Import Element wrapper extension methods
clr.AddReference("RevitNodes")
import Revit
clr.ImportExtensions(Revit.Elements)

# Import geometry conversion extension methods

clr.ImportExtensions(Revit.GeometryConversion)

# Import DocumentManager and TransactionManager
clr.AddReference("RevitServices")
import RevitServices
from RevitServices.Persistence import DocumentManager
from RevitServices.Transactions import TransactionManager

doc = DocumentManager.Instance.CurrentDBDocument
uiapp = DocumentManager.Instance.CurrentUIApplication
app = uiapp.Application

# Import RevitAPI
clr.AddReference("RevitAPI")
import Autodesk
from Autodesk.Revit.DB import *

import sys
pyt_path = r'C:\Program Files (x86)\IronPython 2.7\Lib'
sys.path.append(pyt_path)
import System

sys.path.append("C:\Python27\Lib")
from string import ascii_letters

#Creates an object that can collect / find elements of any catagory
collector = Autodesk.Revit.DB.FilteredElementCollector(doc)

lineList = list()
with open(IN[0]) as f:
  for line in f:
    lineList.append(line.replace("\n", "").split(","))

#Unwraps input
def Unwrap(item):
	return UnwrapElement(item)
	
# ignore the first item since it's a header
t = Transaction(doc, "CreatingGrids")
grids = []
t.Start()
for line in lineList[1:]:
	curve = Line.CreateBound(XYZ(float(line[0]), float(line[1]), 0), XYZ(float(line[2]), float(line[3]), 0))
	grid = Grid.Create(doc, curve)
	grid.Name = line[4]
	grids.append(grid)
	
t.Commit()
#Assign your output to the OUT variable.
OUT = 
# ----------------------------------------
